# Grasshopper definition communication_test_00.gh (Grasshopper 1.0.8)

panel = Panel("{\"command\":\"forward\",\"payload\":{\"command\":\"get_status\",\"job_id\":\"862623f2-a384-43f4-99bf-61f6c8c0335b\"}}")

panel_2 = Panel("base")
panel_3 = Panel("1")
panel_5 = Panel("all")
panel_6 = Panel("eye_to_base")
panel_7 = Panel("2")
panel_8 = Panel("8")

# ---- group: Capture & Transform
connect = BooleanToggle(False)
capture = Button()
transform = Button()
capture_index = ValueList({"1", "2", "3", "4", "5"}, selected="2")
mode = ValueList({"pointcloud", "image", "depth", "all"}, selected="all")
pipeline = ValueList({"base", "ref_cam", "eye_to_base"}, selected="eye_to_base")
eye_to_base_index = ValueList({"1", "2", "3"}, selected="1")
reference_index = ValueList({"1", "2", "3"}, selected="2")
output_index = ValueList({"1", "2", "3", "4", "5", "6", "7", "8", "9", "10"}, selected="2")
refresh_status = BooleanToggle(False)
panel_9 = Panel("RT_Test_00")
c_script = CSharpScript(
    ConnectButton=connect,
    CaptureButton=capture,
    TransformButton=transform,
    SessionName=panel_9,
    CaptureIndex=capture_index,
    Mode=mode,
    Pipeline=pipeline,
    EyeToBaseIndex=eye_to_base_index,
    ReferenceIndex=reference_index,
    OutputIndex=output_index,
    RefreshStatus=refresh_status)  # -> Status, Message; inputs ConnectButton: Boolean, CaptureButton: Boolean, TransformButton: Boolean, SessionName: String, CaptureIndex: Int32, Mode: String, Pipeline: String, EyeToBaseIndex: Int32, ReferenceIndex: Int32, OutputIndex: Int32, RefreshStatus: Boolean
# ---------- c_script: C# ----------
// Grasshopper Script Instance
#region Usings
using System;
using System.Text;
using System.Net.Sockets;
using System.Linq;
using System.Collections;
using System.Collections.Generic;
using System.Drawing;

using Rhino;
using Rhino.Geometry;

using Grasshopper;
using Grasshopper.Kernel;
using Grasshopper.Kernel.Data;
using Grasshopper.Kernel.Types;
#endregion

public class Script_Instance : GH_ScriptInstance
{
    private bool previousCaptureButton = false;
    private bool previousTransformButton = false;

    private bool isConnected = false;
    private bool triedConnect = false;

    private string lastStatus = "Disconnected";
    private string lastMessage = "Click Connect first.";

    private void RunScript(
		bool ConnectButton,
		bool CaptureButton,
		bool TransformButton,
		string SessionName,
		int CaptureIndex,
		string Mode,
		string Pipeline,
		int EyeToBaseIndex,
		int ReferenceIndex,
		int OutputIndex,
		bool RefreshStatus,
		ref object Status,
		ref object Message)
    {
        string host = "127.0.0.1";
        int port = 6005;

        bool triggerCapture = CaptureButton && !previousCaptureButton;
        previousCaptureButton = CaptureButton;

        bool triggerTransform = TransformButton && !previousTransformButton;
        previousTransformButton = TransformButton;

        if (!ConnectButton)
        {
            isConnected = false;
            triedConnect = false;
            lastStatus = "Disconnected";
            lastMessage = "Connection toggle is off.";
            Status = lastStatus;
            Message = lastMessage;
            return;
        }

        if (ConnectButton && !isConnected && !triedConnect)
        {
            triedConnect = true;

            string response = SendCommand(
                host,
                port,
                "{\"command\":\"ping\"}"
            );

            if (response.StartsWith("ERROR:"))
            {
                isConnected = false;
                lastStatus = "Connection failed";
                lastMessage = response;
            }
            else
            {
                isConnected = true;
                lastStatus = "Connected";
                lastMessage = response;
            }
        }

        if (!isConnected)
        {
            Status = lastStatus;
            Message = lastMessage;
            return;
        }

        if (triggerCapture)
        {
            string session = string.IsNullOrWhiteSpace(SessionName)
                ? "RQC_Capture_Session"
                : SessionName;

            string mode = string.IsNullOrWhiteSpace(Mode)
                ? "all"
                : Mode;

            string capturePayload =
                "{\"command\":\"forward\",\"payload\":{" +
                "\"command\":\"capture\"," +
                "\"session\":\"" + EscapeJson(session) + "\"," +
                "\"camera_index\":0," +
                "\"capture_index\":" + CaptureIndex.ToString() + "," +
                "\"mode\":\"" + EscapeJson(mode) + "\"" +
                "}}";

            string response = SendCommand(host, port, capturePayload);

            if (response.StartsWith("ERROR:"))
            {
                lastStatus = "Capture submit failed";
                lastMessage = response;
            }
            else
            {
                lastStatus = "Capture submitted";
                lastMessage = response;
            }
        }

        if (triggerTransform)
        {
            string session = string.IsNullOrWhiteSpace(SessionName)
                ? "RQC_Capture_Session"
                : SessionName;

            string pipeline = string.IsNullOrWhiteSpace(Pipeline)
                ? "eye_to_base"
                : Pipeline;

            string transformPayload =
                "{\"command\":\"forward\",\"payload\":{" +
                "\"command\":\"transform\"," +
                "\"session\":\"" + EscapeJson(session) + "\"," +
                "\"pipeline\":\"" + EscapeJson(pipeline) + "\"," +
                "\"eye_to_base_index\":" + EyeToBaseIndex.ToString() + "," +
                "\"reference_index\":" + ReferenceIndex.ToString() + "," +
                "\"output_index\":" + OutputIndex.ToString() +
                "}}";

            string response = SendCommand(host, port, transformPayload);

            if (response.StartsWith("ERROR:"))
            {
                lastStatus = "Transform submit failed";
                lastMessage = response;
            }
            else
            {
                lastStatus = "Transform submitted";
                lastMessage = response;
            }
        }

        if (RefreshStatus)
        {
            string statusPayload = "{\"command\":\"get_latest_status\"}";
            string response = SendCommand(host, port, statusPayload);

            if (response.StartsWith("ERROR:"))
            {
                isConnected = false;
                triedConnect = true;
                lastStatus = "Connection lost";
                lastMessage = response;
            }
            else
            {
                string status = ExtractJsonValue(response, "latest_job_status");
                string message = ExtractJsonValue(response, "latest_message");

                lastStatus = string.IsNullOrWhiteSpace(status)
                    ? "Connected"
                    : status;

                lastMessage = string.IsNullOrWhiteSpace(message)
                    ? response
                    : message;
            }
        }

        Status = lastStatus;
        Message = lastMessage;
    }

    private string SendCommand(string host, int port, string command)
    {
        int headerSize = 8;

        try
        {
            using (TcpClient client = new TcpClient())
            {
                IAsyncResult result = client.BeginConnect(host, port, null, null);

                bool success = result.AsyncWaitHandle.WaitOne(
                    TimeSpan.FromMilliseconds(300)
                );

                if (!success)
                    return "ERROR: GH Agent connection timeout.";

                client.EndConnect(result);

                using (NetworkStream stream = client.GetStream())
                {
                    byte[] payload = Encoding.UTF8.GetBytes(command);

                    byte[] header = new byte[headerSize];
                    ulong size = (ulong)payload.Length;

                    for (int i = 0; i < headerSize; i++)
                    {
                        header[headerSize - 1 - i] = (byte)(size & 0xFF);
                        size >>= 8;
                    }

                    stream.Write(header, 0, header.Length);
                    stream.Write(payload, 0, payload.Length);

                    byte[] responseHeader = ReadExact(stream, headerSize);

                    ulong responseSize = 0;
                    for (int i = 0; i < headerSize; i++)
                    {
                        responseSize = (responseSize << 8) + responseHeader[i];
                    }

                    byte[] responsePayload = ReadExact(stream, (int)responseSize);
                    return Encoding.UTF8.GetString(responsePayload);
                }
            }
        }
        catch (Exception e)
        {
            return "ERROR: " + e.Message;
        }
    }

    private byte[] ReadExact(NetworkStream stream, int size)
    {
        byte[] data = new byte[size];
        int offset = 0;

        while (offset < size)
        {
            int read = stream.Read(data, offset, size - offset);

            if (read == 0)
                throw new Exception("Connection closed.");

            offset += read;
        }

        return data;
    }

    private string EscapeJson(string value)
    {
        if (value == null)
            return "";

        return value
            .Replace("\\", "\\\\")
            .Replace("\"", "\\\"");
    }

    private string ExtractJsonValue(string json, string key)
    {
        string pattern = "\"" + key + "\":";
        int start = json.IndexOf(pattern);

        if (start < 0)
            return "";

        start += pattern.Length;

        while (start < json.Length && char.IsWhiteSpace(json[start]))
            start++;

        if (start >= json.Length)
            return "";

        if (json[start] == '"')
        {
            start++;
            int end = json.IndexOf("\"", start);

            if (end < 0)
                return "";

            return json.Substring(start, end - start);
        }
        else
        {
            int end = start;

            while (
                end < json.Length &&
                json[end] != ',' &&
                json[end] != '}')
            {
                end++;
            }

            return json.Substring(start, end - start).Trim();
        }
    }
}
# ---------- end c_script ----------
trigger = Trigger(Interval=1000, TimerInterval=1000, Target=[c_script, c_script_7])  # disabled
panel_10 = Panel(c_script.Status)
panel_11 = Panel(c_script.Message)

# ----
download = Button()
file_types = ValueList({"pointcloud", "image", "json"}, selected="pointcloud")

# ---- group: Capture, Transform & Processing
connect_2 = BooleanToggle(False)
capture_2 = Button()
transform_2 = Button()
process = Button()
panel_12 = Panel("EOB_test03")
capture_index_2 = ValueList({"1", "2", "3", "4", "5"}, selected="1")
mode_2 = ValueList({"pointcloud", "image", "depth", "all"}, selected="all")
pipeline_2 = ValueList({"base", "ref_cam", "eye_to_base"}, selected="eye_to_base")
eye_to_base_index_2 = ValueList({"1", "2", "3"}, selected="1")
reference_index_2 = ValueList({"1", "2", "3"}, selected="2")
output_index_2 = ValueList({"1", "2", "3", "4", "5", "6", "7", "8", "9", "10"}, selected="1")
processing_input_kind = ValueList({"merged", "eye_to_base"}, selected="eye_to_base")
show_processing_preview = BooleanToggle(True)
processing_preview_time = Slider(1, range=0..5)
color_grouping_method = ValueList({"gmm_bic", "dbscan", "reference"}, selected="gmm_bic")
max_color_groups = Slider(1, range=1..5)
gmm_merge_distance = Slider(6, range=0..20)
refresh_status_2 = BooleanToggle(False)
c_script_2 = CSharpScript(
    ConnectButton=connect_2,
    CaptureButton=capture_2,
    TransformButton=transform_2,
    ProcessButton=process,
    SessionName=panel_12,
    CaptureIndex=capture_index_2,
    Mode=mode_2,
    Pipeline=pipeline_2,
    EyeToBaseIndex=eye_to_base_index_2,
    ReferenceIndex=reference_index_2,
    OutputIndex=output_index_2,
    ProcessingInputKind=processing_input_kind,
    ShowProcessingPreview=show_processing_preview,
    ProcessingPreviewTime=processing_preview_time,
    ColorGroupingMethod=color_grouping_method,
    MaxColorGroups=max_color_groups,
    GmmMergeDistance=gmm_merge_distance,
    RefreshStatus=refresh_status_2)  # -> Status, Message; inputs ConnectButton: Boolean, CaptureButton: Boolean, TransformButton: Boolean, ProcessButton: Boolean, SessionName: String, CaptureIndex: Int32, Mode: String, Pipeline: String, EyeToBaseIndex: Int32, ReferenceIndex: Int32, OutputIndex: Int32, ProcessingInputKind: String, ShowProcessingPreview: Boolean, ProcessingPreviewTime: Double, ColorGroupingMethod: String, MaxColorGroups: Int32, GmmMergeDistance: Double, RefreshStatus: Boolean
# ---------- c_script_2: C# ----------
// Grasshopper Script Instance
#region Usings
using System;
using System.Text;
using System.Net.Sockets;
using System.Linq;
using System.Collections;
using System.Collections.Generic;
using System.Drawing;
using System.Globalization;

using Rhino;
using Rhino.Geometry;

using Grasshopper;
using Grasshopper.Kernel;
using Grasshopper.Kernel.Data;
using Grasshopper.Kernel.Types;
#endregion

public class Script_Instance : GH_ScriptInstance
{
    private bool previousCaptureButton = false;
    private bool previousTransformButton = false;

    // Added only for processing-button edge detection.
    private bool previousProcessButton = false;

    private bool isConnected = false;
    private bool triedConnect = false;

    private string lastStatus = "Disconnected";
    private string lastMessage = "Click Connect first.";

    private void RunScript(
		bool ConnectButton,
		bool CaptureButton,
		bool TransformButton,
		bool ProcessButton,
		string SessionName,
		int CaptureIndex,
		string Mode,
		string Pipeline,
		int EyeToBaseIndex,
		int ReferenceIndex,
		int OutputIndex,
		string ProcessingInputKind,
		bool ShowProcessingPreview,
		double ProcessingPreviewTime,
		string ColorGroupingMethod,
		int MaxColorGroups,
		double GmmMergeDistance,
		bool RefreshStatus,
		ref object Status,
		ref object Message)
    {
        string host = "127.0.0.1";
        int port = 6005;

        // Existing capture trigger.
        bool triggerCapture =
            CaptureButton &&
            !previousCaptureButton;

        previousCaptureButton = CaptureButton;

        // Existing transform trigger.
        bool triggerTransform =
            TransformButton &&
            !previousTransformButton;

        previousTransformButton = TransformButton;

        // New processing trigger.
        bool triggerProcess =
            ProcessButton &&
            !previousProcessButton;

        previousProcessButton = ProcessButton;

        // ---------------------------------------------------------
        // Existing connection handling
        // ---------------------------------------------------------

        if (!ConnectButton)
        {
            isConnected = false;
            triedConnect = false;

            lastStatus = "Disconnected";
            lastMessage = "Connection toggle is off.";

            Status = lastStatus;
            Message = lastMessage;
            return;
        }

        if (
            ConnectButton &&
            !isConnected &&
            !triedConnect)
        {
            triedConnect = true;

            string response = SendCommand(
                host,
                port,
                "{\"command\":\"ping\"}"
            );

            if (response.StartsWith("ERROR:"))
            {
                isConnected = false;
                lastStatus = "Connection failed";
                lastMessage = response;
            }
            else
            {
                isConnected = true;
                lastStatus = "Connected";
                lastMessage = response;
            }
        }

        if (!isConnected)
        {
            Status = lastStatus;
            Message = lastMessage;
            return;
        }

        // ---------------------------------------------------------
        // Existing capture workflow
        // ---------------------------------------------------------

        if (triggerCapture)
        {
            string session =
                string.IsNullOrWhiteSpace(SessionName)
                ? "RQC_Capture_Session"
                : SessionName;

            string mode =
                string.IsNullOrWhiteSpace(Mode)
                ? "all"
                : Mode;

            string capturePayload =
                "{\"command\":\"forward\",\"payload\":{" +
                "\"command\":\"capture\"," +
                "\"session\":\"" +
                EscapeJson(session) +
                "\"," +
                "\"camera_index\":0," +
                "\"capture_index\":" +
                CaptureIndex.ToString() +
                "," +
                "\"mode\":\"" +
                EscapeJson(mode) +
                "\"" +
                "}}";

            string response = SendCommand(
                host,
                port,
                capturePayload
            );

            if (response.StartsWith("ERROR:"))
            {
                lastStatus = "Capture submit failed";
                lastMessage = response;
            }
            else
            {
                lastStatus = "Capture submitted";
                lastMessage = response;
            }
        }

        // ---------------------------------------------------------
        // Existing transform workflow
        // ---------------------------------------------------------

        if (triggerTransform)
        {
            string session =
                string.IsNullOrWhiteSpace(SessionName)
                ? "RQC_Capture_Session"
                : SessionName;

            string pipeline =
                string.IsNullOrWhiteSpace(Pipeline)
                ? "eye_to_base"
                : Pipeline;

            string transformPayload =
                "{\"command\":\"forward\",\"payload\":{" +
                "\"command\":\"transform\"," +
                "\"session\":\"" +
                EscapeJson(session) +
                "\"," +
                "\"pipeline\":\"" +
                EscapeJson(pipeline) +
                "\"," +
                "\"eye_to_base_index\":" +
                EyeToBaseIndex.ToString() +
                "," +
                "\"reference_index\":" +
                ReferenceIndex.ToString() +
                "," +
                "\"output_index\":" +
                OutputIndex.ToString() +
                "}}";

            string response = SendCommand(
                host,
                port,
                transformPayload
            );

            if (response.StartsWith("ERROR:"))
            {
                lastStatus = "Transform submit failed";
                lastMessage = response;
            }
            else
            {
                lastStatus = "Transform submitted";
                lastMessage = response;
            }
        }

        // ---------------------------------------------------------
        // New processing workflow
        // ---------------------------------------------------------

        if (triggerProcess)
        {
            string session =
                string.IsNullOrWhiteSpace(SessionName)
                ? "RQC_Capture_Session"
                : SessionName;

            string inputKind =
                NormalizeProcessingInputKind(
                    ProcessingInputKind
                );

            string groupingMethod =
                NormalizeColorGroupingMethod(
                    ColorGroupingMethod
                );

            int maxGroups = Math.Max(
                1,
                MaxColorGroups
            );

            double mergeDistance = Math.Max(
                0.0,
                GmmMergeDistance
            );

            /*
             * Preview behavior:
             *
             * ShowProcessingPreview = false
             *     show_preview = false
             *     preview_time_sec = null
             *
             * ShowProcessingPreview = true
             * ProcessingPreviewTime <= 0
             *     show_preview = true
             *     preview_time_sec = null
             *     previews remain open until manually closed
             *
             * ShowProcessingPreview = true
             * ProcessingPreviewTime > 0
             *     show_preview = true
             *     preview_time_sec = supplied number
             */

            string previewTimeJson = "null";

            if (
                ShowProcessingPreview &&
                ProcessingPreviewTime > 0.0)
            {
                previewTimeJson =
                    ProcessingPreviewTime.ToString(
                        "0.########",
                        CultureInfo.InvariantCulture
                    );
            }

            string processPayload =
                "{\"command\":\"forward\",\"payload\":{" +

                "\"command\":\"process\"," +

                "\"session\":\"" +
                EscapeJson(session) +
                "\"," +

                "\"output_index\":" +
                OutputIndex.ToString(
                    CultureInfo.InvariantCulture
                ) +
                "," +

                "\"input_kind\":\"" +
                EscapeJson(inputKind) +
                "\"," +

                "\"show_preview\":" +
                BoolToJson(
                    ShowProcessingPreview
                ) +
                "," +

                "\"preview_time_sec\":" +
                previewTimeJson +
                "," +

                "\"color_grouping_method\":\"" +
                EscapeJson(groupingMethod) +
                "\"," +

                "\"gmm_max_groups\":" +
                maxGroups.ToString(
                    CultureInfo.InvariantCulture
                ) +
                "," +

                "\"gmm_merge_distance\":" +
                mergeDistance.ToString(
                    "0.########",
                    CultureInfo.InvariantCulture
                ) +

                "}}";

            string response = SendCommand(
                host,
                port,
                processPayload
            );

            if (response.StartsWith("ERROR:"))
            {
                lastStatus =
                    "Processing submit failed";

                lastMessage = response;
            }
            else
            {
                lastStatus =
                    "Processing submitted";

                lastMessage = response;
            }
        }

        // ---------------------------------------------------------
        // Existing status refresh
        // ---------------------------------------------------------

        if (RefreshStatus)
        {
            string statusPayload =
                "{\"command\":\"get_latest_status\"}";

            string response = SendCommand(
                host,
                port,
                statusPayload
            );

            if (response.StartsWith("ERROR:"))
            {
                isConnected = false;
                triedConnect = true;

                lastStatus = "Connection lost";
                lastMessage = response;
            }
            else
            {
                string status = ExtractJsonValue(
                    response,
                    "latest_job_status"
                );

                string message = ExtractJsonValue(
                    response,
                    "latest_message"
                );

                lastStatus =
                    string.IsNullOrWhiteSpace(status)
                    ? "Connected"
                    : status;

                lastMessage =
                    string.IsNullOrWhiteSpace(message)
                    ? response
                    : message;
            }
        }

        Status = lastStatus;
        Message = lastMessage;
    }

    // -------------------------------------------------------------
    // New processing input validation helpers
    // -------------------------------------------------------------

    private string NormalizeProcessingInputKind(
        string value)
    {
        string normalized =
            string.IsNullOrWhiteSpace(value)
            ? "eye_to_base"
            : value.Trim().ToLowerInvariant();

        if (
            normalized != "eye_to_base" &&
            normalized != "merged" &&
            normalized != "initial")
        {
            return "eye_to_base";
        }

        return normalized;
    }

    private string NormalizeColorGroupingMethod(
        string value)
    {
        string normalized =
            string.IsNullOrWhiteSpace(value)
            ? "gmm_bic"
            : value.Trim().ToLowerInvariant();

        if (
            normalized != "gmm_bic" &&
            normalized != "dbscan" &&
            normalized != "reference")
        {
            return "gmm_bic";
        }

        return normalized;
    }

    private string BoolToJson(bool value)
    {
        return value
            ? "true"
            : "false";
    }

    // -------------------------------------------------------------
    // Existing TCP helper
    // -------------------------------------------------------------

    private string SendCommand(
        string host,
        int port,
        string command)
    {
        int headerSize = 8;

        try
        {
            using (TcpClient client = new TcpClient())
            {
                IAsyncResult result =
                    client.BeginConnect(
                        host,
                        port,
                        null,
                        null
                    );

                bool success =
                    result.AsyncWaitHandle.WaitOne(
                        TimeSpan.FromMilliseconds(300)
                    );

                if (!success)
                {
                    return
                        "ERROR: GH Agent connection timeout.";
                }

                client.EndConnect(result);

                using (
                    NetworkStream stream =
                        client.GetStream())
                {
                    byte[] payload =
                        Encoding.UTF8.GetBytes(
                            command
                        );

                    byte[] header =
                        new byte[headerSize];

                    ulong size =
                        (ulong)payload.Length;

                    for (
                        int i = 0;
                        i < headerSize;
                        i++)
                    {
                        header[
                            headerSize - 1 - i
                        ] = (byte)(
                            size & 0xFF
                        );

                        size >>= 8;
                    }

                    stream.Write(
                        header,
                        0,
                        header.Length
                    );

                    stream.Write(
                        payload,
                        0,
                        payload.Length
                    );

                    byte[] responseHeader =
                        ReadExact(
                            stream,
                            headerSize
                        );

                    ulong responseSize = 0;

                    for (
                        int i = 0;
                        i < headerSize;
                        i++)
                    {
                        responseSize =
                            (responseSize << 8) +
                            responseHeader[i];
                    }

                    if (
                        responseSize >
                        int.MaxValue)
                    {
                        return
                            "ERROR: Agent response is too large.";
                    }

                    byte[] responsePayload =
                        ReadExact(
                            stream,
                            (int)responseSize
                        );

                    return Encoding.UTF8.GetString(
                        responsePayload
                    );
                }
            }
        }
        catch (Exception e)
        {
            return "ERROR: " + e.Message;
        }
    }

    private byte[] ReadExact(
        NetworkStream stream,
        int size)
    {
        byte[] data = new byte[size];
        int offset = 0;

        while (offset < size)
        {
            int read = stream.Read(
                data,
                offset,
                size - offset
            );

            if (read == 0)
            {
                throw new Exception(
                    "Connection closed."
                );
            }

            offset += read;
        }

        return data;
    }

    private string EscapeJson(string value)
    {
        if (value == null)
            return "";

        return value
            .Replace("\\", "\\\\")
            .Replace("\"", "\\\"")
            .Replace("\r", "\\r")
            .Replace("\n", "\\n")
            .Replace("\t", "\\t");
    }

    private string ExtractJsonValue(
        string json,
        string key)
    {
        string pattern =
            "\"" + key + "\":";

        int start =
            json.IndexOf(
                pattern,
                StringComparison.Ordinal
            );

        if (start < 0)
            return "";

        start += pattern.Length;

        while (
            start < json.Length &&
            char.IsWhiteSpace(json[start]))
        {
            start++;
        }

        if (start >= json.Length)
            return "";

        if (json[start] == '"')
        {
            start++;

            StringBuilder value =
                new StringBuilder();

            bool escaped = false;

            for (
                int i = start;
                i < json.Length;
                i++)
            {
                char character = json[i];

                if (escaped)
                {
                    switch (character)
                    {
                        case 'n':
                            value.Append('\n');
                            break;

                        case 'r':
                            value.Append('\r');
                            break;

                        case 't':
                            value.Append('\t');
                            break;

                        case '\\':
                            value.Append('\\');
                            break;

                        case '"':
                            value.Append('"');
                            break;

                        default:
                            value.Append(character);
                            break;
                    }

                    escaped = false;
                    continue;
                }

                if (character == '\\')
                {
                    escaped = true;
                    continue;
                }

                if (character == '"')
                {
                    return value.ToString();
                }

                value.Append(character);
            }

            return "";
        }
        else
        {
            int end = start;

            while (
                end < json.Length &&
                json[end] != ',' &&
                json[end] != '}')
            {
                end++;
            }

            return json
                .Substring(
                    start,
                    end - start
                )
                .Trim();
        }
    }
}
# ---------- end c_script_2 ----------
trigger_2 = Trigger(Interval=1000, TimerInterval=1000, Target=[c_script_2, c_script_3])  # disabled
panel_13 = Panel(c_script_2.Status)
panel_14 = Panel(c_script_2.Message)

# ---- group: Download
download_2 = Button()
file_types_2 = ValueList({"pointcloud", "image", "json"}, selected="json")
category = ValueList({"all": "", "initial_pointcloud", "merged_pointcloud", "eye_to_base_pointcloud", "initial_rgb", "initial_depth", "initial_depth_rendered", "stitched_rgb", "stitched_height", "eye_to_base_rgb", "eye_to_base_height", "processed_clusters", "processing_params", "processing_report"}, selected="processed_clusters")
c_script_3 = CSharpScript(
    ConnectButton=connect_2,
    DownloadButton=download_2,
    SessionName=panel_12,
    OutputIndex=output_index_2,
    FileTypes=file_types_2,
    Category=category,
    RefreshStatus=refresh_status_2)  # -> Status, Message, PointCloudPaths, ImagePaths, JsonPaths; inputs ConnectButton: Boolean, DownloadButton: Boolean, SessionName: String, OutputIndex: Int32, FileTypes: String, Category: String, RefreshStatus: Boolean
# ---------- c_script_3: C# ----------
// Grasshopper Script Instance
#region Usings
using System;
using System.Text;
using System.Net.Sockets;
using System.Linq;
using System.Collections;
using System.Collections.Generic;
using System.Drawing;

using Rhino;
using Rhino.Geometry;

using Grasshopper;
using Grasshopper.Kernel;
using Grasshopper.Kernel.Data;
using Grasshopper.Kernel.Types;
#endregion

public class Script_Instance : GH_ScriptInstance
{
    private bool previousDownloadButton = false;

    private bool isConnected = false;
    private bool triedConnect = false;

    private string lastStatus = "Disconnected";
    private string lastMessage = "Click Connect first.";

    private List<string> lastPointCloudPaths = new List<string>();
    private List<string> lastImagePaths = new List<string>();
    private List<string> lastJsonPaths = new List<string>();

    private void RunScript(
		bool ConnectButton,
		bool DownloadButton,
		string SessionName,
		int OutputIndex,
		string FileTypes,
		string Category,
		bool RefreshStatus,
		ref object Status,
		ref object Message,
		ref object PointCloudPaths,
		ref object ImagePaths,
		ref object JsonPaths)
    {
        string host = "127.0.0.1";
        int port = 6005;

        bool triggerDownload = DownloadButton && !previousDownloadButton;
        previousDownloadButton = DownloadButton;

        if (!ConnectButton)
        {
            isConnected = false;
            triedConnect = false;
            lastStatus = "Disconnected";
            lastMessage = "Connection toggle is off.";
            Status = lastStatus;
            Message = lastMessage;
            PointCloudPaths = lastPointCloudPaths;
            ImagePaths = lastImagePaths;
            JsonPaths = lastJsonPaths;
            return;
        }

        if (ConnectButton && !isConnected && !triedConnect)
        {
            triedConnect = true;

            string response = SendCommand(
                host,
                port,
                "{\"command\":\"ping\"}"
            );

            if (response.StartsWith("ERROR:"))
            {
                isConnected = false;
                lastStatus = "Connection failed";
                lastMessage = response;
            }
            else
            {
                isConnected = true;
                lastStatus = "Connected";
                lastMessage = response;
            }
        }

        if (!isConnected)
        {
            Status = lastStatus;
            Message = lastMessage;
            PointCloudPaths = lastPointCloudPaths;
            ImagePaths = lastImagePaths;
            JsonPaths = lastJsonPaths;
            return;
        }

        if (triggerDownload)
        {
            string session = string.IsNullOrWhiteSpace(SessionName)
                ? "RQC_Capture_Session"
                : SessionName;

            string fileTypesJson = BuildFileTypesArray(FileTypes);

            string downloadPayload =
                "{\"command\":\"downloadable_outputs\"," +
                "\"session\":\"" + EscapeJson(session) + "\"," +
                "\"output_index\":" + OutputIndex.ToString() + "," +
                "\"file_types\":" + fileTypesJson +
                "}";

            string response = SendCommand(host, port, downloadPayload);

            if (response.StartsWith("ERROR:"))
            {
                lastStatus = "Download failed";
                lastMessage = response;
            }
            else
            {
                lastStatus = "Download requested";
                lastMessage = response;
            }
        }

        if (RefreshStatus)
        {
            string session = string.IsNullOrWhiteSpace(SessionName)
                ? "RQC_Capture_Session"
                : SessionName;

            // ---------------------------------------------------------
            // 1. Read the current download/job status
            // ---------------------------------------------------------

            string statusPayload =
                "{\"command\":\"get_latest_status\"}";

            string statusResponse = SendCommand(
                host,
                port,
                statusPayload
            );

            if (statusResponse.StartsWith("ERROR:"))
            {
                isConnected = false;
                triedConnect = true;

                lastStatus = "Connection lost";
                lastMessage = statusResponse;
            }
            else
            {
                string currentStatus = ExtractJsonValue(
                    statusResponse,
                    "latest_job_status"
                );

                string currentMessage = ExtractJsonValue(
                    statusResponse,
                    "latest_message"
                );

                lastStatus =
                    string.IsNullOrWhiteSpace(currentStatus)
                    ? "Connected"
                    : currentStatus;

                lastMessage =
                    string.IsNullOrWhiteSpace(currentMessage)
                    ? statusResponse
                    : currentMessage;

                // -----------------------------------------------------
                // 2. Read paths from the persistent session manifest
                // -----------------------------------------------------

                string fileTypesJson =
                    BuildFileTypesArray(FileTypes);

                string categoriesJson =
                    BuildCategoriesArray(Category);

                string localFilesPayload =
                    "{\"command\":\"list_local_downloads\"," +
                    "\"session\":\"" +
                    EscapeJson(session) +
                    "\"," +
                    "\"output_index\":" +
                    OutputIndex.ToString() +
                    "," +
                    "\"file_types\":" +
                    fileTypesJson +
                    "," +
                    "\"categories\":" +
                    categoriesJson +
                    "}";

                string localFilesResponse = SendCommand(
                    host,
                    port,
                    localFilesPayload
                );

                if (localFilesResponse.StartsWith("ERROR:"))
                {
                    // Preserve the previously displayed paths.
                    lastMessage =
                        lastMessage +
                        Environment.NewLine +
                        "Local manifest read failed: " +
                        localFilesResponse;
                }
                else
                {
                    // Replace the displayed paths with the manifest result
                    // for the currently selected session, output and category.
                    lastPointCloudPaths =
                        ExtractLocalPathsByCategory(
                            localFilesResponse,
                            "pointclouds"
                        );

                    lastImagePaths =
                        ExtractLocalPathsByCategory(
                            localFilesResponse,
                            "images"
                        );

                    lastJsonPaths =
                        ExtractLocalPathsByCategory(
                            localFilesResponse,
                            "json"
                        );
                }
            }
        }

        Status = lastStatus;
        Message = lastMessage;
        PointCloudPaths = lastPointCloudPaths;
        ImagePaths = lastImagePaths;
        JsonPaths = lastJsonPaths;
    }

    private string BuildFileTypesArray(string fileTypes)
    {
        if (string.IsNullOrWhiteSpace(fileTypes))
            return "[\"pointcloud\",\"image\",\"json\"]";

        string[] parts = fileTypes.Split(',');

        List<string> cleaned = new List<string>();

        foreach (string part in parts)
        {
            string value = part.Trim().ToLower();

            if (value == "pointcloud" || value == "pointclouds" || value == "pcd" || value == "ply")
                cleaned.Add("\"pointcloud\"");

            else if (value == "image" || value == "images" || value == "img" || value == "png")
                cleaned.Add("\"image\"");

            else if (value == "json")
                cleaned.Add("\"json\"");
        }

        if (cleaned.Count == 0)
            return "[\"pointcloud\",\"image\",\"json\"]";

        return "[" + string.Join(",", cleaned) + "]";
    }

    private string BuildCategoriesArray(string categories)
    {
        /*
        * Blank means no category filtering.
        * The GH Agent will return all stored files for the selected
        * file types, session and output index.
        */
        if (string.IsNullOrWhiteSpace(categories))
            return "[]";

        string[] parts = categories.Split(',');

        List<string> cleaned =
            new List<string>();

        HashSet<string> unique =
            new HashSet<string>(
                StringComparer.OrdinalIgnoreCase
            );

        foreach (string part in parts)
        {
            string value = part
                .Trim()
                .ToLowerInvariant();

            if (string.IsNullOrWhiteSpace(value))
                continue;

            if (unique.Add(value))
            {
                cleaned.Add(
                    "\"" +
                    EscapeJson(value) +
                    "\""
                );
            }
        }

        return "[" +
            string.Join(",", cleaned) +
            "]";
    }


   private List<string> ExtractLocalPathsByCategory(string json, string category)
    {
        HashSet<string> uniquePaths = new HashSet<string>();
        List<string> paths = new List<string>();

        int searchStart = 0;

        while (true)
        {
            int localPathIndex = json.IndexOf("\"local_path\":", searchStart);
            if (localPathIndex < 0)
                break;

            string path = ExtractJsonStringAt(
                json,
                localPathIndex + "\"local_path\":".Length
            );

            if (!string.IsNullOrWhiteSpace(path))
            {
                string normalized = path.Replace("/", "\\").ToLower();
                string categoryFolder = "\\" + category.ToLower() + "\\";

                if (normalized.Contains(categoryFolder))
                {
                    string key = normalized.Trim();

                    if (!uniquePaths.Contains(key))
                    {
                        uniquePaths.Add(key);
                        paths.Add(path);
                    }
                }
            }

            searchStart = localPathIndex + 1;
        }

        return paths;
    }
    

    private string ExtractJsonStringAt(string json, int start)
    {
        while (start < json.Length && char.IsWhiteSpace(json[start]))
            start++;

        if (start >= json.Length || json[start] != '"')
            return "";

        start++;

        StringBuilder sb = new StringBuilder();
        bool escape = false;

        for (int i = start; i < json.Length; i++)
        {
            char c = json[i];

            if (escape)
            {
                if (c == '\\') sb.Append('\\');
                else if (c == '"') sb.Append('"');
                else if (c == 'n') sb.Append('\n');
                else if (c == 'r') sb.Append('\r');
                else if (c == 't') sb.Append('\t');
                else sb.Append(c);

                escape = false;
            }
            else
            {
                if (c == '\\')
                    escape = true;
                else if (c == '"')
                    break;
                else
                    sb.Append(c);
            }
        }

        return sb.ToString();
    }

    private string SendCommand(string host, int port, string command)
    {
        int headerSize = 8;

        try
        {
            using (TcpClient client = new TcpClient())
            {
                IAsyncResult result = client.BeginConnect(host, port, null, null);

                bool success = result.AsyncWaitHandle.WaitOne(
                    TimeSpan.FromMilliseconds(300)
                );

                if (!success)
                    return "ERROR: GH Agent connection timeout.";

                client.EndConnect(result);

                using (NetworkStream stream = client.GetStream())
                {
                    byte[] payload = Encoding.UTF8.GetBytes(command);

                    byte[] header = new byte[headerSize];
                    ulong size = (ulong)payload.Length;

                    for (int i = 0; i < headerSize; i++)
                    {
                        header[headerSize - 1 - i] = (byte)(size & 0xFF);
                        size >>= 8;
                    }

                    stream.Write(header, 0, header.Length);
                    stream.Write(payload, 0, payload.Length);

                    byte[] responseHeader = ReadExact(stream, headerSize);

                    ulong responseSize = 0;
                    for (int i = 0; i < headerSize; i++)
                    {
                        responseSize = (responseSize << 8) + responseHeader[i];
                    }

                    byte[] responsePayload = ReadExact(stream, (int)responseSize);
                    return Encoding.UTF8.GetString(responsePayload);
                }
            }
        }
        catch (Exception e)
        {
            return "ERROR: " + e.Message;
        }
    }

    private byte[] ReadExact(NetworkStream stream, int size)
    {
        byte[] data = new byte[size];
        int offset = 0;

        while (offset < size)
        {
            int read = stream.Read(data, offset, size - offset);

            if (read == 0)
                throw new Exception("Connection closed.");

            offset += read;
        }

        return data;
    }

    private string EscapeJson(string value)
    {
        if (value == null)
            return "";

        return value
            .Replace("\\", "\\\\")
            .Replace("\"", "\\\"");
    }

    private string ExtractJsonValue(string json, string key)
    {
        string pattern = "\"" + key + "\":";
        int start = json.IndexOf(pattern);

        if (start < 0)
            return "";

        start += pattern.Length;

        while (start < json.Length && char.IsWhiteSpace(json[start]))
            start++;

        if (start >= json.Length)
            return "";

        if (json[start] == '"')
        {
            start++;
            int end = json.IndexOf("\"", start);

            if (end < 0)
                return "";

            return json.Substring(start, end - start);
        }
        else
        {
            int end = start;

            while (
                end < json.Length &&
                json[end] != ',' &&
                json[end] != '}')
            {
                end++;
            }

            return json.Substring(start, end - start).Trim();
        }
    }
}
# ---------- end c_script_3 ----------
panel_15 = Panel(c_script_3.Status)
panel_16 = Panel(c_script_3.Message)
path = FilePath(c_script_3.PointCloudPaths)
import = ImportContent(FilePath=path)  # -> Objects, Layers, Linetypes, HatchPatterns, AnnotationStyles, Materials, BlockDefinitions

# ----
panel_17 = Panel("{\"command\":\"forward\",\"payload\":{\"command\":\"capture\",\"session\":\"RQC_Capture_Session\",\"camera_index\":0,\"capture_index\":1,\"mode\":\"all\"}}")
panel_18 = Panel("{\"command\":\"ping_python\"}")
panel_19 = Panel("{\"command\":\"forward\",\"payload\":{\"command\":\"capture\"}}")
panel_20 = Panel("{\"command\":\"forward\",\"payload\":{\"command\":\"capture\",\"session\":\"0_GH03\",\"camera_index\":0,\"capture_index\":1,\"mode\":\"all\"}}")

# ---- group: Capture
trigger_3 = Trigger(Interval=1000, TimerInterval=1000, Target=c_script_4)  # disabled
c_script_4 = CSharpScript(
    ConnectButton=Toggle(False),
    CaptureButton=Button(),
    SessionName="0_GH02",
    CaptureIndex="1",
    Mode="all",
    RefreshStatus=Toggle(False))  # -> Status, Message; inputs ConnectButton: Boolean, CaptureButton: Boolean, SessionName: String, CaptureIndex: Int32, Mode: String, RefreshStatus: Boolean
# ---------- c_script_4: C# ----------
// Grasshopper Script Instance
#region Usings
using System;
using System.Text;
using System.Net.Sockets;
using System.Linq;
using System.Collections;
using System.Collections.Generic;
using System.Drawing;

using Rhino;
using Rhino.Geometry;

using Grasshopper;
using Grasshopper.Kernel;
using Grasshopper.Kernel.Data;
using Grasshopper.Kernel.Types;
#endregion

public class Script_Instance : GH_ScriptInstance
{
    private bool previousCaptureButton = false;

    private bool isConnected = false;
    private bool triedConnect = false;

    private string lastStatus = "Disconnected";
    private string lastMessage = "Click Connect first.";

    private void RunScript(
		bool ConnectButton,
		bool CaptureButton,
		string SessionName,
		int CaptureIndex,
		string Mode,
		bool RefreshStatus,
		ref object Status,
		ref object Message)
    {
        string host = "127.0.0.1";
        int port = 6005;

        bool triggerCapture = CaptureButton && !previousCaptureButton;
        previousCaptureButton = CaptureButton;

        if (!ConnectButton)
        {
            isConnected = false;
            triedConnect = false;
            lastStatus = "Disconnected";
            lastMessage = "Connection toggle is off.";
            Status = lastStatus;
            Message = lastMessage;
            return;
        }

        if (ConnectButton && !isConnected && !triedConnect)
        {
            triedConnect = true;

            string response = SendCommand(
                host,
                port,
                "{\"command\":\"ping\"}"
            );

            if (response.StartsWith("ERROR:"))
            {
                isConnected = false;
                lastStatus = "Connection failed";
                lastMessage = response;
            }
            else
            {
                isConnected = true;
                lastStatus = "Connected";
                lastMessage = response;
            }
        }

        if (!isConnected)
        {
            Status = lastStatus;
            Message = lastMessage;
            return;
        }

        if (triggerCapture)
        {
            string session = string.IsNullOrWhiteSpace(SessionName)
                ? "RQC_Capture_Session"
                : SessionName;

            string mode = string.IsNullOrWhiteSpace(Mode)
                ? "all"
                : Mode;

            string capturePayload =
                "{\"command\":\"forward\",\"payload\":{" +
                "\"command\":\"capture\"," +
                "\"session\":\"" + EscapeJson(session) + "\"," +
                "\"camera_index\":0," +
                "\"capture_index\":" + CaptureIndex.ToString() + "," +
                "\"mode\":\"" + EscapeJson(mode) + "\"" +
                "}}";

            string response = SendCommand(host, port, capturePayload);

            if (response.StartsWith("ERROR:"))
            {
                lastStatus = "Capture submit failed";
                lastMessage = response;
            }
            else
            {
                lastStatus = "Capture submitted";
                lastMessage = response;
            }
        }

        if (RefreshStatus)
        {
            string statusPayload = "{\"command\":\"get_latest_status\"}";
            string response = SendCommand(host, port, statusPayload);

            if (response.StartsWith("ERROR:"))
            {
                isConnected = false;
                triedConnect = true;
                lastStatus = "Connection lost";
                lastMessage = response;
            }
            else
            {
                string status = ExtractJsonValue(response, "latest_job_status");
                string message = ExtractJsonValue(response, "latest_message");

                lastStatus = string.IsNullOrWhiteSpace(status)
                    ? "Connected"
                    : status;

                lastMessage = string.IsNullOrWhiteSpace(message)
                    ? response
                    : message;
            }
        }

        Status = lastStatus;
        Message = lastMessage;
    }

    private string SendCommand(string host, int port, string command)
    {
        int headerSize = 8;

        try
        {
            using (TcpClient client = new TcpClient())
            {
                IAsyncResult result = client.BeginConnect(host, port, null, null);

                bool success = result.AsyncWaitHandle.WaitOne(
                    TimeSpan.FromMilliseconds(300)
                );

                if (!success)
                    return "ERROR: GH Agent connection timeout.";

                client.EndConnect(result);

                using (NetworkStream stream = client.GetStream())
                {
                    byte[] payload = Encoding.UTF8.GetBytes(command);

                    byte[] header = new byte[headerSize];
                    ulong size = (ulong)payload.Length;

                    for (int i = 0; i < headerSize; i++)
                    {
                        header[headerSize - 1 - i] = (byte)(size & 0xFF);
                        size >>= 8;
                    }

                    stream.Write(header, 0, header.Length);
                    stream.Write(payload, 0, payload.Length);

                    byte[] responseHeader = ReadExact(stream, headerSize);

                    ulong responseSize = 0;
                    for (int i = 0; i < headerSize; i++)
                    {
                        responseSize = (responseSize << 8) + responseHeader[i];
                    }

                    byte[] responsePayload = ReadExact(stream, (int)responseSize);
                    return Encoding.UTF8.GetString(responsePayload);
                }
            }
        }
        catch (Exception e)
        {
            return "ERROR: " + e.Message;
        }
    }

    private byte[] ReadExact(NetworkStream stream, int size)
    {
        byte[] data = new byte[size];
        int offset = 0;

        while (offset < size)
        {
            int read = stream.Read(data, offset, size - offset);

            if (read == 0)
                throw new Exception("Connection closed.");

            offset += read;
        }

        return data;
    }

    private string EscapeJson(string value)
    {
        if (value == null)
            return "";

        return value
            .Replace("\\", "\\\\")
            .Replace("\"", "\\\"");
    }

    private string ExtractJsonValue(string json, string key)
    {
        string pattern = "\"" + key + "\":";
        int start = json.IndexOf(pattern);

        if (start < 0)
            return "";

        start += pattern.Length;

        while (start < json.Length && char.IsWhiteSpace(json[start]))
            start++;

        if (start >= json.Length)
            return "";

        if (json[start] == '"')
        {
            start++;
            int end = json.IndexOf("\"", start);

            if (end < 0)
                return "";

            return json.Substring(start, end - start);
        }
        else
        {
            int end = start;

            while (
                end < json.Length &&
                json[end] != ',' &&
                json[end] != '}')
            {
                end++;
            }

            return json.Substring(start, end - start).Trim();
        }
    }
}
# ---------- end c_script_4 ----------
panel_21 = Panel(c_script_4.Message)
panel_22 = Panel(c_script_4.Status)

# ---- group: Transform
c_script_5 = CSharpScript(
    ConnectButton=Toggle(False),
    TransformButton=Button(),
    SessionName="EOB_test01",
    Pipeline="eye_to_base",
    EyeToBaseIndex="1",
    ReferenceIndex="2",
    RefreshStatus=Toggle(False))  # -> Status, Message; inputs ConnectButton: Boolean, TransformButton: Boolean, SessionName: String, Pipeline: String, EyeToBaseIndex: Int32, ReferenceIndex: Int32, RefreshStatus: Boolean
# ---------- c_script_5: C# ----------
// Grasshopper Script Instance
#region Usings
using System;
using System.Text;
using System.Net.Sockets;
using System.Linq;
using System.Collections;
using System.Collections.Generic;
using System.Drawing;

using Rhino;
using Rhino.Geometry;

using Grasshopper;
using Grasshopper.Kernel;
using Grasshopper.Kernel.Data;
using Grasshopper.Kernel.Types;
#endregion

public class Script_Instance : GH_ScriptInstance
{
    private bool previousTransformButton = false;

    private bool isConnected = false;
    private bool triedConnect = false;

    private string lastStatus = "Disconnected";
    private string lastMessage = "Click Connect first.";

    private void RunScript(
		bool ConnectButton,
		bool TransformButton,
		string SessionName,
		string Pipeline,
		int EyeToBaseIndex,
		int ReferenceIndex,
		bool RefreshStatus,
		ref object Status,
		ref object Message)
    {
        string host = "127.0.0.1";
        int port = 6005;

        bool triggerTransform = TransformButton && !previousTransformButton;
        previousTransformButton = TransformButton;

        if (!ConnectButton)
        {
            isConnected = false;
            triedConnect = false;
            lastStatus = "Disconnected";
            lastMessage = "Connection toggle is off.";
            Status = lastStatus;
            Message = lastMessage;
            return;
        }

        if (ConnectButton && !isConnected && !triedConnect)
        {
            triedConnect = true;

            string response = SendCommand(
                host,
                port,
                "{\"command\":\"ping\"}"
            );

            if (response.StartsWith("ERROR:"))
            {
                isConnected = false;
                lastStatus = "Connection failed";
                lastMessage = response;
            }
            else
            {
                isConnected = true;
                lastStatus = "Connected";
                lastMessage = response;
            }
        }

        if (!isConnected)
        {
            Status = lastStatus;
            Message = lastMessage;
            return;
        }

        if (triggerTransform)
        {
            string session = string.IsNullOrWhiteSpace(SessionName)
                ? "RQC_Capture_Session"
                : SessionName;

            string pipeline = string.IsNullOrWhiteSpace(Pipeline)
                ? "eye_to_base"
                : Pipeline;

            string transformPayload =
                "{\"command\":\"forward\",\"payload\":{" +
                "\"command\":\"transform\"," +
                "\"session\":\"" + EscapeJson(session) + "\"," +
                "\"pipeline\":\"" + EscapeJson(pipeline) + "\"," +
                "\"eye_to_base_index\":" + EyeToBaseIndex.ToString() + "," +
                "\"reference_index\":" + ReferenceIndex.ToString() +
                "}}";

            string response = SendCommand(host, port, transformPayload);

            if (response.StartsWith("ERROR:"))
            {
                lastStatus = "Transform submit failed";
                lastMessage = response;
            }
            else
            {
                lastStatus = "Transform submitted";
                lastMessage = response;
            }
        }

        if (RefreshStatus)
        {
            string statusPayload = "{\"command\":\"get_latest_status\"}";
            string response = SendCommand(host, port, statusPayload);

            if (response.StartsWith("ERROR:"))
            {
                isConnected = false;
                triedConnect = true;
                lastStatus = "Connection lost";
                lastMessage = response;
            }
            else
            {
                string status = ExtractJsonValue(response, "latest_job_status");
                string message = ExtractJsonValue(response, "latest_message");

                lastStatus = string.IsNullOrWhiteSpace(status)
                    ? "Connected"
                    : status;

                lastMessage = string.IsNullOrWhiteSpace(message)
                    ? response
                    : message;
            }
        }

        Status = lastStatus;
        Message = lastMessage;
    }

    private string SendCommand(string host, int port, string command)
    {
        int headerSize = 8;

        try
        {
            using (TcpClient client = new TcpClient())
            {
                IAsyncResult result = client.BeginConnect(host, port, null, null);

                bool success = result.AsyncWaitHandle.WaitOne(
                    TimeSpan.FromMilliseconds(300)
                );

                if (!success)
                    return "ERROR: GH Agent connection timeout.";

                client.EndConnect(result);

                using (NetworkStream stream = client.GetStream())
                {
                    byte[] payload = Encoding.UTF8.GetBytes(command);

                    byte[] header = new byte[headerSize];
                    ulong size = (ulong)payload.Length;

                    for (int i = 0; i < headerSize; i++)
                    {
                        header[headerSize - 1 - i] = (byte)(size & 0xFF);
                        size >>= 8;
                    }

                    stream.Write(header, 0, header.Length);
                    stream.Write(payload, 0, payload.Length);

                    byte[] responseHeader = ReadExact(stream, headerSize);

                    ulong responseSize = 0;
                    for (int i = 0; i < headerSize; i++)
                    {
                        responseSize = (responseSize << 8) + responseHeader[i];
                    }

                    byte[] responsePayload = ReadExact(stream, (int)responseSize);
                    return Encoding.UTF8.GetString(responsePayload);
                }
            }
        }
        catch (Exception e)
        {
            return "ERROR: " + e.Message;
        }
    }

    private byte[] ReadExact(NetworkStream stream, int size)
    {
        byte[] data = new byte[size];
        int offset = 0;

        while (offset < size)
        {
            int read = stream.Read(data, offset, size - offset);

            if (read == 0)
                throw new Exception("Connection closed.");

            offset += read;
        }

        return data;
    }

    private string EscapeJson(string value)
    {
        if (value == null)
            return "";

        return value
            .Replace("\\", "\\\\")
            .Replace("\"", "\\\"");
    }

    private string ExtractJsonValue(string json, string key)
    {
        string pattern = "\"" + key + "\":";
        int start = json.IndexOf(pattern);

        if (start < 0)
            return "";

        start += pattern.Length;

        while (start < json.Length && char.IsWhiteSpace(json[start]))
            start++;

        if (start >= json.Length)
            return "";

        if (json[start] == '"')
        {
            start++;
            int end = json.IndexOf("\"", start);

            if (end < 0)
                return "";

            return json.Substring(start, end - start);
        }
        else
        {
            int end = start;

            while (
                end < json.Length &&
                json[end] != ',' &&
                json[end] != '}')
            {
                end++;
            }

            return json.Substring(start, end - start).Trim();
        }
    }
}
# ---------- end c_script_5 ----------
trigger_4 = Trigger(Interval=1000, TimerInterval=1000, Target=c_script_5)  # disabled
panel_23 = Panel(c_script_5.Message)
panel_24 = Panel(c_script_5.Status)

# ----
button = Button()
c_script_6 = CSharpScript(Run=Toggle(False), Command=panel_17)  # -> Response; inputs Run: Boolean, Command: String
# ---------- c_script_6: C# ----------
// Grasshopper Script Instance
#region Usings
using System;
using System.Text;
using System.Net.Sockets;
using System.Linq;
using System.Collections;
using System.Collections.Generic;
using System.Drawing;

using Rhino;
using Rhino.Geometry;

using Grasshopper;
using Grasshopper.Kernel;
using Grasshopper.Kernel.Data;
using Grasshopper.Kernel.Types;
#endregion

public class Script_Instance : GH_ScriptInstance
{
    private void RunScript(bool Run, string Command, ref object Response)
    {
        if (!Run)
        {
            Response = "Waiting...";
            return;
        }

        string host = "127.0.0.1";
        int port = 6005;
        int headerSize = 8;

        try
        {
            using (TcpClient client = new TcpClient(host, port))
            using (NetworkStream stream = client.GetStream())
            {
                byte[] payload = Encoding.UTF8.GetBytes(Command);

                byte[] header = new byte[headerSize];
                ulong size = (ulong)payload.Length;

                for (int i = 0; i < headerSize; i++)
                {
                    header[headerSize - 1 - i] = (byte)(size & 0xFF);
                    size >>= 8;
                }

                stream.Write(header, 0, header.Length);
                stream.Write(payload, 0, payload.Length);

                byte[] responseHeader = ReadExact(stream, headerSize);

                ulong responseSize = 0;
                for (int i = 0; i < headerSize; i++)
                {
                    responseSize = (responseSize << 8) + responseHeader[i];
                }

                byte[] responsePayload = ReadExact(stream, (int)responseSize);
                Response = Encoding.UTF8.GetString(responsePayload);
            }
        }
        catch (Exception e)
        {
            Response = "ERROR: " + e.Message;
        }
    }

    private byte[] ReadExact(NetworkStream stream, int size)
    {
        byte[] data = new byte[size];
        int offset = 0;

        while (offset < size)
        {
            int read = stream.Read(data, offset, size - offset);

            if (read == 0)
            {
                throw new Exception("Connection closed.");
            }

            offset += read;
        }

        return data;
    }
}
# ---------- end c_script_6 ----------
c_script_7 = CSharpScript(
    ConnectButton=connect,
    DownloadButton=download,
    SessionName=panel_9,
    OutputIndex=output_index,
    FileTypes=file_types,
    RefreshStatus=refresh_status)  # -> Status, Message, PointCloudPaths, ImagePaths, JsonPaths; inputs ConnectButton: Boolean, DownloadButton: Boolean, SessionName: String, OutputIndex: Int32, FileTypes: String, RefreshStatus: Boolean
# ---------- c_script_7: C# ----------
// Grasshopper Script Instance
#region Usings
using System;
using System.Text;
using System.Net.Sockets;
using System.Linq;
using System.Collections;
using System.Collections.Generic;
using System.Drawing;

using Rhino;
using Rhino.Geometry;

using Grasshopper;
using Grasshopper.Kernel;
using Grasshopper.Kernel.Data;
using Grasshopper.Kernel.Types;
#endregion

public class Script_Instance : GH_ScriptInstance
{
    private bool previousDownloadButton = false;

    private bool isConnected = false;
    private bool triedConnect = false;

    private string lastStatus = "Disconnected";
    private string lastMessage = "Click Connect first.";

    private List<string> lastPointCloudPaths = new List<string>();
    private List<string> lastImagePaths = new List<string>();
    private List<string> lastJsonPaths = new List<string>();

    private void RunScript(
		bool ConnectButton,
		bool DownloadButton,
		string SessionName,
		int OutputIndex,
		string FileTypes,
		bool RefreshStatus,
		ref object Status,
		ref object Message,
		ref object PointCloudPaths,
		ref object ImagePaths,
		ref object JsonPaths)
    {
        string host = "127.0.0.1";
        int port = 6005;

        bool triggerDownload = DownloadButton && !previousDownloadButton;
        previousDownloadButton = DownloadButton;

        if (!ConnectButton)
        {
            isConnected = false;
            triedConnect = false;
            lastStatus = "Disconnected";
            lastMessage = "Connection toggle is off.";
            Status = lastStatus;
            Message = lastMessage;
            PointCloudPaths = lastPointCloudPaths;
            ImagePaths = lastImagePaths;
            JsonPaths = lastJsonPaths;
            return;
        }

        if (ConnectButton && !isConnected && !triedConnect)
        {
            triedConnect = true;

            string response = SendCommand(
                host,
                port,
                "{\"command\":\"ping\"}"
            );

            if (response.StartsWith("ERROR:"))
            {
                isConnected = false;
                lastStatus = "Connection failed";
                lastMessage = response;
            }
            else
            {
                isConnected = true;
                lastStatus = "Connected";
                lastMessage = response;
            }
        }

        if (!isConnected)
        {
            Status = lastStatus;
            Message = lastMessage;
            PointCloudPaths = lastPointCloudPaths;
            ImagePaths = lastImagePaths;
            JsonPaths = lastJsonPaths;
            return;
        }

        if (triggerDownload)
        {
            string session = string.IsNullOrWhiteSpace(SessionName)
                ? "RQC_Capture_Session"
                : SessionName;

            string fileTypesJson = BuildFileTypesArray(FileTypes);

            string downloadPayload =
                "{\"command\":\"downloadable_outputs\"," +
                "\"session\":\"" + EscapeJson(session) + "\"," +
                "\"output_index\":" + OutputIndex.ToString() + "," +
                "\"file_types\":" + fileTypesJson +
                "}";

            string response = SendCommand(host, port, downloadPayload);

            if (response.StartsWith("ERROR:"))
            {
                lastStatus = "Download failed";
                lastMessage = response;
            }
            else
            {
                lastStatus = "Download requested";
                lastMessage = response;
            }
        }

        if (RefreshStatus)
        {
            string statusPayload = "{\"command\":\"get_latest_status\"}";
            string response = SendCommand(host, port, statusPayload);

            if (response.StartsWith("ERROR:"))
            {
                isConnected = false;
                triedConnect = true;
                lastStatus = "Connection lost";
                lastMessage = response;
            }
            else
            {
                string status = ExtractJsonValue(response, "latest_job_status");
                string message = ExtractJsonValue(response, "latest_message");

                lastStatus = string.IsNullOrWhiteSpace(status)
                    ? "Connected"
                    : status;

                lastMessage = string.IsNullOrWhiteSpace(message)
                    ? response
                    : message;

                lastPointCloudPaths = ExtractLocalPathsByCategory(response, "pointclouds");
                lastImagePaths = ExtractLocalPathsByCategory(response, "images");
                lastJsonPaths = ExtractLocalPathsByCategory(response, "json");
            }
        }

        Status = lastStatus;
        Message = lastMessage;
        PointCloudPaths = lastPointCloudPaths;
        ImagePaths = lastImagePaths;
        JsonPaths = lastJsonPaths;
    }

    private string BuildFileTypesArray(string fileTypes)
    {
        if (string.IsNullOrWhiteSpace(fileTypes))
            return "[\"pointcloud\",\"image\",\"json\"]";

        string[] parts = fileTypes.Split(',');

        List<string> cleaned = new List<string>();

        foreach (string part in parts)
        {
            string value = part.Trim().ToLower();

            if (value == "pointcloud" || value == "pointclouds" || value == "pcd" || value == "ply")
                cleaned.Add("\"pointcloud\"");

            else if (value == "image" || value == "images" || value == "img" || value == "png")
                cleaned.Add("\"image\"");

            else if (value == "json")
                cleaned.Add("\"json\"");
        }

        if (cleaned.Count == 0)
            return "[\"pointcloud\",\"image\",\"json\"]";

        return "[" + string.Join(",", cleaned) + "]";
    }

   private List<string> ExtractLocalPathsByCategory(string json, string category)
    {
        HashSet<string> uniquePaths = new HashSet<string>();
        List<string> paths = new List<string>();

        int searchStart = 0;

        while (true)
        {
            int localPathIndex = json.IndexOf("\"local_path\":", searchStart);
            if (localPathIndex < 0)
                break;

            string path = ExtractJsonStringAt(
                json,
                localPathIndex + "\"local_path\":".Length
            );

            if (!string.IsNullOrWhiteSpace(path))
            {
                string normalized = path.Replace("/", "\\").ToLower();
                string categoryFolder = "\\" + category.ToLower() + "\\";

                if (normalized.Contains(categoryFolder))
                {
                    string key = normalized.Trim();

                    if (!uniquePaths.Contains(key))
                    {
                        uniquePaths.Add(key);
                        paths.Add(path);
                    }
                }
            }

            searchStart = localPathIndex + 1;
        }

        return paths;
    }
    

    private string ExtractJsonStringAt(string json, int start)
    {
        while (start < json.Length && char.IsWhiteSpace(json[start]))
            start++;

        if (start >= json.Length || json[start] != '"')
            return "";

        start++;

        StringBuilder sb = new StringBuilder();
        bool escape = false;

        for (int i = start; i < json.Length; i++)
        {
            char c = json[i];

            if (escape)
            {
                if (c == '\\') sb.Append('\\');
                else if (c == '"') sb.Append('"');
                else if (c == 'n') sb.Append('\n');
                else if (c == 'r') sb.Append('\r');
                else if (c == 't') sb.Append('\t');
                else sb.Append(c);

                escape = false;
            }
            else
            {
                if (c == '\\')
                    escape = true;
                else if (c == '"')
                    break;
                else
                    sb.Append(c);
            }
        }

        return sb.ToString();
    }

    private string SendCommand(string host, int port, string command)
    {
        int headerSize = 8;

        try
        {
            using (TcpClient client = new TcpClient())
            {
                IAsyncResult result = client.BeginConnect(host, port, null, null);

                bool success = result.AsyncWaitHandle.WaitOne(
                    TimeSpan.FromMilliseconds(300)
                );

                if (!success)
                    return "ERROR: GH Agent connection timeout.";

                client.EndConnect(result);

                using (NetworkStream stream = client.GetStream())
                {
                    byte[] payload = Encoding.UTF8.GetBytes(command);

                    byte[] header = new byte[headerSize];
                    ulong size = (ulong)payload.Length;

                    for (int i = 0; i < headerSize; i++)
                    {
                        header[headerSize - 1 - i] = (byte)(size & 0xFF);
                        size >>= 8;
                    }

                    stream.Write(header, 0, header.Length);
                    stream.Write(payload, 0, payload.Length);

                    byte[] responseHeader = ReadExact(stream, headerSize);

                    ulong responseSize = 0;
                    for (int i = 0; i < headerSize; i++)
                    {
                        responseSize = (responseSize << 8) + responseHeader[i];
                    }

                    byte[] responsePayload = ReadExact(stream, (int)responseSize);
                    return Encoding.UTF8.GetString(responsePayload);
                }
            }
        }
        catch (Exception e)
        {
            return "ERROR: " + e.Message;
        }
    }

    private byte[] ReadExact(NetworkStream stream, int size)
    {
        byte[] data = new byte[size];
        int offset = 0;

        while (offset < size)
        {
            int read = stream.Read(data, offset, size - offset);

            if (read == 0)
                throw new Exception("Connection closed.");

            offset += read;
        }

        return data;
    }

    private string EscapeJson(string value)
    {
        if (value == null)
            return "";

        return value
            .Replace("\\", "\\\\")
            .Replace("\"", "\\\"");
    }

    private string ExtractJsonValue(string json, string key)
    {
        string pattern = "\"" + key + "\":";
        int start = json.IndexOf(pattern);

        if (start < 0)
            return "";

        start += pattern.Length;

        while (start < json.Length && char.IsWhiteSpace(json[start]))
            start++;

        if (start >= json.Length)
            return "";

        if (json[start] == '"')
        {
            start++;
            int end = json.IndexOf("\"", start);

            if (end < 0)
                return "";

            return json.Substring(start, end - start);
        }
        else
        {
            int end = start;

            while (
                end < json.Length &&
                json[end] != ',' &&
                json[end] != '}')
            {
                end++;
            }

            return json.Substring(start, end - start).Trim();
        }
    }
}
# ---------- end c_script_7 ----------
panel_25 = Panel(c_script_6)
panel_26 = Panel(c_script_7.Status)
panel_27 = Panel(c_script_7.Message)
path_2 = FilePath(c_script_7.PointCloudPaths)
import_2 = ImportContent(FilePath=path_2)  # -> Objects, Layers, Linetypes, HatchPatterns, AnnotationStyles, Materials, BlockDefinitions
path_3 = FilePath(c_script_3.JsonPaths)
panel_28 = Panel(path_3)

path_4 = FilePath(path_3)
py3 = Python3Script(FileOrFolder=path_4, UseLatestInFolder=Toggle(True), MakeClosed=Toggle(True))  # -> Polylines, Centroids, MeanColors, Info
# ---------- py3: Python ----------
# GHPython script (Rhino/Grasshopper)
# Inputs:
#   FileOrFolder      : str (File Path OR folder)
#   UseLatestInFolder : bool (default True)
#   MakeClosed        : bool (default True)
# Outputs:
#   Polylines         : DataTree[Rhino.Geometry.Curve]           # in millimeters
#   Centroids         : DataTree[Rhino.Geometry.Point3d]         # in millimeters
#   MeanColors        : DataTree[System.Drawing.Color]
#   Info              : str

import os, json
import Rhino as rc
from Grasshopper import DataTree
from Grasshopper.Kernel.Data import GH_Path
import System
from System.Drawing import Color

# ---------- helpers ----------
def _bool_or_default(val, default):
    return default if (val is None) else bool(val)

def _latest_json_in_folder(folder):
    files = [os.path.join(folder, f) for f in os.listdir(folder) if f.lower().endswith(".json")]
    if not files:
        raise IOError("No .json files found in folder: {}".format(folder))
    files.sort(key=lambda p: os.path.getmtime(p), reverse=True)
    return files[0]

def _coerce_point3d(obj):
    if isinstance(obj, (list, tuple)) and len(obj) == 3:
        try:
            return rc.Geometry.Point3d(float(obj[0]), float(obj[1]), float(obj[2])), None
        except Exception as e:
            return None, "list/tuple cast failed: {}".format(e)
    if isinstance(obj, dict):
        lower = {str(k).lower(): v for k, v in obj.items()}
        if all(k in lower for k in ("x","y","z")):
            try:
                return rc.Geometry.Point3d(float(lower["x"]), float(lower["y"]), float(lower["z"])), None
            except Exception as e:
                return None, "dict cast failed: {}".format(e)
        return None, "dict missing x/y/z keys"
    return None, "unsupported type: {}".format(type(obj).__name__)

def _make_polylinecurve(pts, make_closed=True, tol=1e-9):
    if not pts or len(pts) < 2:
        return None
    pl = rc.Geometry.Polyline()
    for p in pts:
        pl.Add(p)
    if make_closed and pl.Count >= 3:
        last_idx = pl.Count - 1
        if pl[0].DistanceTo(pl[last_idx]) > tol:
            pl.Add(pl[0])
    try:
        plc = pl.ToPolylineCurve()
        if plc and plc.IsValid:
            return plc
    except:
        pass
    try:
        plc = rc.Geometry.PolylineCurve(list(pl))
        if plc and plc.IsValid:
            return plc
    except:
        pass
    return None

def _rgb_to_color(rgb):
    """rgb can be [r,g,b] in 0..1 or 0..255 -> System.Drawing.Color"""
    if not isinstance(rgb, (list, tuple)) or len(rgb) != 3:
        return None
    try:
        r, g, b = float(rgb[0]), float(rgb[1]), float(rgb[2])
    except:
        return None
    if max(r, g, b) <= 1.0:
        r, g, b = int(round(r * 255.0)), int(round(g * 255.0)), int(round(b * 255.0))
    else:
        r, g, b = int(round(r)), int(round(g)), int(round(b))
    r = max(0, min(255, r))
    g = max(0, min(255, g))
    b = max(0, min(255, b))
    return Color.FromArgb(255, r, g, b)

# --- meters -> millimeters helpers ---
def _mm_xform():
    """Uniform scale x1000 about world origin."""
    return rc.Geometry.Transform.Scale(rc.Geometry.Point3d.Origin, 1000.0)

def _to_mm_curve(curve):
    """Duplicate & scale a curve to mm."""
    if curve is None: return None
    dup = curve.DuplicateCurve()
    if dup is None: return None
    xf = _mm_xform()
    ok = dup.Transform(xf)
    return dup if ok else None

def _to_mm_point(pt):
    """Return a scaled copy of a point in mm."""
    if pt is None: return None
    p = rc.Geometry.Point3d(pt)
    p.Transform(_mm_xform())
    return p

# ---------- inputs / path ----------
if not FileOrFolder:
    raise ValueError("Provide a file path or a folder path to your JSON.")

use_latest = _bool_or_default(UseLatestInFolder, True)
make_closed = _bool_or_default(MakeClosed, True)

path = str(FileOrFolder)
if os.path.isdir(path):
    if use_latest:
        path = _latest_json_in_folder(path)
    else:
        raise ValueError("Folder given. Set UseLatestInFolder=True or pass a specific .json file path.")
elif not os.path.isfile(path):
    raise IOError("Path does not exist: {}".format(path))
elif not path.lower().endswith(".json"):
    raise IOError("File is not a .json: {}".format(path))

# ---------- load ----------
with open(path, "r") as f:
    data = json.load(f)

clusters = data.get("clusters", [])
units_in = data.get("units", "meters")  # original units in file (for Info)

# ---------- outputs ----------
Polylines  = DataTree[rc.Geometry.Curve]()          # in mm
Centroids  = DataTree[rc.Geometry.Point3d]()        # in mm
MeanColors = DataTree[Color]()                      

made_pl = 0
made_cent = 0
made_color = 0

# ---------- build ----------
for i, c in enumerate(clusters):
    # indices + color group
    try:
        plane_idx   = int(c.get("plane_index", 1)) if isinstance(c, dict) else 1
        cluster_idx = int(c.get("cluster_index", i)) if isinstance(c, dict) else i
    except:
        plane_idx, cluster_idx = 1, i

    cg = c.get("color_group", {}) if isinstance(c, dict) else {}
    try:
        group_id = int(cg.get("group_id", -1))
    except:
        group_id = -1

    # branch path = {group_id; cluster_index}
    path_key = GH_Path(group_id, cluster_idx)

    # hull -> polyline (meters)
    hull_raw = c.get("hull_3d", [])
    pts = []
    if isinstance(hull_raw, list):
        for h in hull_raw:
            pt, _ = _coerce_point3d(h)
            if pt is not None:
                pts.append(pt)

    plc_m = _make_polylinecurve(pts, make_closed)
    plc_mm = _to_mm_curve(plc_m) if (plc_m is not None and plc_m.IsValid) else None
    if plc_mm is not None and plc_mm.IsValid:
        Polylines.Add(plc_mm, path_key)
        made_pl += 1

    # centroid (meters -> mm)
    cent_raw = c.get("centroid_3d", None)
    if cent_raw is not None:
        cpt_m, _ = _coerce_point3d(cent_raw)
        cpt_mm = _to_mm_point(cpt_m)
        if cpt_mm is not None:
            Centroids.Add(cpt_mm, path_key)
            made_cent += 1

    # mean color (unitless)
    mean_rgb = cg.get("group_mean_rgb", None)
    col = _rgb_to_color(mean_rgb) if mean_rgb is not None else None
    if col is not None:
        MeanColors.Add(col, path_key)
        made_color += 1

# ---------- summary ----------
Info = "File: {} | Clusters: {} | Polylines(mm): {} | Centroids(mm): {} | MeanColors: {} | source_units: {}".format(
    os.path.basename(path), len(clusters), made_pl, made_cent, made_color, units_in
)
# ---------- end py3 ----------
panel_29 = Panel(py3.Info)
crv = Curve(py3.Polylines)
pt = Point(py3.Centroids)
panel_30 = Panel(py3.MeanColors)
